# Grasshopper definition Jewelry_Peacock_2024.gh (Grasshopper 1.0.7)

image = ImageSampler(Filter="Colour", Interpolate=False, Umax=1, Umin=0, Vmax=1, Vmin=0, Wrap=1)
image_2 = ImageSampler(Filter="Colour", Interpolate=False, Umax=1, Umin=0, Vmax=1, Vmin=0, Wrap=1)
list = ValueList({"項鍊": 0, "耳環": 1}, selected="項鍊")

wearing_type = GetInteger(Slider(1, range=0..1), AtLeast=1, AtMost=1, Maximum=1, Minimum=0, TreeAccess=False)

# ---- group: 耳針
earhook = Brep(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)

# ----
Z = UnitZ(Factor="33")
ear = Ear(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)
Y = UnitY(Factor=expr("-x", "7"))
move = Move(Geometry=ear, Motion=Z)  # -> Geometry, Transform
move_2 = Move(Geometry=move.Geometry, Motion=Y)  # -> Geometry, Transform
項墜條 = Brep(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)
filter = StreamFilter(Gate=wearing_type, Stream0=項墜條, Stream1=earhook)
preview = CustomPreview(Geometry=filter, Material=ColourSwatch(SwatchColor=RGB(255, 3, 3)))

# ---- group: 上半身胸像
Z_2 = UnitZ(Factor=expr("-x", "350"))
bust = Bust(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)
move_3 = Move(Geometry=bust, Motion=Z_2)  # -> Geometry, Transform
Y_2 = UnitY(Factor="60")
move_4 = Move(Geometry=move_3.Geometry, Motion=Y_2)  # -> Geometry, Transform
volume = Volume(Geometry=move_4.Geometry)  # -> Volume, Centroid
yz = YZPlane(Origin=volume.Centroid)
rotate = Rotate(Geometry=move_4.Geometry, Angle=degrees("20"), Plane=yz)  # -> Geometry, Transform
filter_2 = StreamFilter(Gate=wearing_type, Stream0=rotate.Geometry, Stream1=move_2.Geometry)
preview_2 = CustomPreview(
    Geometry=filter_2,
    Material={diffuse=RGB(33, 33, 33), emission=RGB(0, 0, 0), shine=0.1828497124, specular=RGB(255, 255, 255), transparency=0})

# ----
context_bake = ContextBake(Geo_Chain=filter)
context_bake_2 = ContextBake(Geometry=filter_2)

# ---- group: 基本多面體
geometry_size = Slider(10, range=10..30)
cuts_amount = Slider(4, range=2..10)
random_cuts = Slider(53, range=0..100)
pt = ConstructPoint(XCoordinate=0, YCoordinate=0, ZCoordinate=0)

# ----
geometry_size_2 = GetInteger(geometry_size, AtLeast=1, AtMost=1, Maximum=30, Minimum=10, TreeAccess=False)
cuts_amount_2 = GetInteger(cuts_amount, AtLeast=1, AtMost=1, Maximum=10, Minimum=2, TreeAccess=False)
random_cuts_2 = GetInteger(random_cuts, AtLeast=1, AtMost=1, Maximum=100, Minimum=0, TreeAccess=False)

# ---- group: 基本多面體 (continued)
sph = Sphere(Base=PlaneXY(0, 0, 0), Radius=geometry_size_2)
popgeo = PopulateGeometry(Geometry=sph, Count=cuts_amount_2, Seed=random_cuts_2)
bbox = BoundingBox(Content=sph, Plane=PlaneXY(0, 0, 0))  # -> Box, Box_2
vcell = VoronoiCell(Point=pt, Neighbours=popgeo, Box=bbox.Box)

# ---- group: 內外層線架構
outside_scale = Slider(0.9, range=0..10)
volume_2 = Volume(Geometry=vcell)  # -> Volume, Centroid
debrep = DeconstructBrep(Brep=vcell)  # -> Faces, Edges, Vertices

# ----
outside_scale_2 = GetNumber(outside_scale, AtLeast=1, AtMost=1, Maximum=10, Minimum=0, TreeAccess=False)

# ---- group: 內外層線架構 (continued)
scale = Scale(Geometry=vcell, Center=volume_2.Centroid, Factor=outside_scale_2)  # -> Geometry, Transform
debrep_2 = DeconstructBrep(Brep=scale.Geometry)  # -> Faces, Edges, Vertices
ln = Line(StartPoint=debrep_2.Vertices, EndPoint=debrep.Vertices)
crv = Curve(flatten([debrep.Edges, debrep_2.Edges, ln]))

# ---- group: 找多面體最長軸，模擬重心
ln_2 = Line(StartPoint=graft(debrep_2.Vertices), EndPoint=debrep_2.Vertices)  # -> flatten(Line)
len = Length(Curve=ln_2)
sort = SortList(Keys=len, ValuesA=ln_2)  # -> reverse(Keys), reverse(ValuesA)
item = ListItem(List=sort.ValuesA, Index=0, Wrap=True)
item_2 = ListItem(List=sort.Keys, Index=0, Wrap=True)
xy = XYPlane(Origin=Point(0, 0, 0))
pframe = PerpFrame(Curve=item, Parameter="0.5")
Z_3 = UnitZ(Factor=expr("-x/2", item_2))
orient = Orient(Geometry=crv, Source=pframe, Target=xy)  # -> Geometry, Transform
move_5 = Move(Geometry=orient.Geometry, Motion=Z_3)  # -> Geometry, Transform

# ---- group: 管狀結構
pipe = Pipe(Curve=move_5.Geometry, Radius="0.5", Caps=1)  # -> flatten(Pipe)
preview_3 = CustomPreview(
    Geometry=pipe,
    Material={diffuse=RGB(0, 0, 0), emission=RGB(0, 0, 0), shine=1, specular=RGB(235, 183, 61), transparency=0})

# ----
geometry = Geometry(pipe)

# ---- group: 鑄造材料成本計算與顯示
volume_3 = Volume(Geometry=pipe)  # -> Volume, Centroid
ma = MassAddition(Input=volume_3.Volume)  # -> Result, PartialResults
cm_cub = Panel("1000")
division = Division(A=ma.Result, B=cm_cub)
比重 = Panel("10.49")
s925銀_32元_克 = Panel("32")
multiplication = Multiplication(A=division, B=比重)
標示材質_重量_成本 = Panel("""Material: S925, 
Weight:{0}g, 
Cost:TWD {1} """)
multiplication_2 = Multiplication(A=multiplication, B=s925銀_32元_克)
format = Format(Format="{0:0.00}", Culture=127, Data0=multiplication_2)
format_2 = Format(Format="{0:0.00}", Culture=127, Data0=multiplication)
pt_2 = Point(Point(40, -40, -20))
xz = XZPlane(Origin=pt_2)
format_3 = Format(Format=標示材質_重量_成本, Culture=127, Data0=format_2, Data1=format)
tag = TextTag3D(Location=xz, Text=format_3, Size="5", Colour=ColourSwatch(SwatchColor=RGB(255, 255, 255)), Justification=7)

# ----
context_bake_3 = ContextBake(Geo_Jewelry=geometry)
